# Grasshopper definition paneling-pavilion.gh (Grasshopper 1.0.7)
# plug-ins: Pufferfish

pt = Point([Point(-11.04668324, 4.014054511, 4.015371391), Point(-10.14495715, -9.694783434, 6.1939195), Point(11.10028115, 0.8536388214, 6.982353483), Point(4.365836567, -9.910899729, 0.8630278738)])
panel = Panel(pt)
openingheight = GetNumber(Slider(10, range=0..10), AtLeast=1, AtMost=2147483647, Maximum=1.797693135e+308, Minimum=-1.797693135e+308)
points = GetPoint(pt, AtLeast=1, AtMost=2147483647, Realtime=True)
udivision = GetNumber(Slider(3, range=1..5), AtLeast=1, AtMost=2147483647, Maximum=1.797693135e+308, Minimum=-1.797693135e+308)
vdivision = GetNumber(Slider(3, range=1..5), AtLeast=1, AtMost=2147483647, Maximum=1.797693135e+308, Minimum=-1.797693135e+308)
xy = XYPlane(Origin=Point(0, 0, 0))
xy_2 = XYPlane(Origin=Point(0, 0, 0))
pdecon = Deconstruct(Point=points)  # -> XComponent, YComponent, ZComponent
hull = ConvexHull(Points=points, Plane=xy)  # -> Hull, HullZ, Indices
division = Division(A=openingheight, B="10")
project = Project(Geometry=points, Plane=xy_2)  # -> Geometry, Transform
crv = Curve(hull.HullZ)
crv_2 = Curve(hull.Hull)
ln = Line(StartPoint=project.Geometry, EndPoint=points)
explode = Explode(Curve=crv, Recursive=True)  # -> Segments, Vertices
item = ListItem(List=explode.Segments, Index=0, Wrap=True)  # -> Item, Item1, Item2, Item3
edgesrf = EdgeSurface(CurveA=item.Item, CurveB=item.Item1, CurveC=item.Item2, CurveD=item.Item3)
sdivide = DivideSurface(Surface=edgesrf, UCount=udivision, VCount=vdivision)  # -> Points, Normals, Parameters
divide = DivideDomain²(Domain=edgesrf, UCount=udivision, VCount=vdivision)
flip = FlipMatrix(Data=sdivide.Points)

# ---- group: point heights
panel_2 = Panel(pdecon.ZComponent)

# ----
subsrf = Isotrim(Surface=edgesrf, Domain=divide)
lng = ListLength(List=flatten(divide))
pline = PolyLine(Vertices=sdivide.Points, Closed=False)
pline_2 = PolyLine(Vertices=flip, Closed=False)
debrep = DeconstructBrep(Brep=subsrf)  # -> Faces, Edges, Vertices
merge = Merge(Data1=pline_2, Data2=pline)
pdecon_2 = Deconstruct(Point=debrep.Vertices)  # -> XComponent, YComponent, ZComponent
sort = SortList(Keys=pdecon_2.ZComponent, ValuesA=debrep.Vertices)  # -> Keys, ValuesA
item_2 = ListItem(List=sort.ValuesA, Index=0, Wrap=True)  # -> Item, Item1, Item2, Item3
project_2 = Project(Geometry=item_2.Item, Plane=PlaneXY(0, 0, 0))  # -> Geometry, Transform
Z = UnitZ(Factor=division)
move = Move(Geometry=item_2.Item, Motion=Z)  # -> Geometry, Transform
panel_3 = Panel(".15")
ln_2 = Line(StartPoint=project_2.Geometry, EndPoint=move.Geometry)  # -> simplify(Line)
merge_2 = Merge(Data1=move.Geometry, Data2=item_2.Item1, Data3=item_2.Item2, Data4=item_2.Item3)
hull_2 = ConvexHull(Points=merge_2, Plane=PlaneXY(0, 0, 0))  # -> Hull, HullZ, Indices
crv_3 = Curve(hull_2.HullZ)
merge_3 = Merge(Data1=ln_2, Data2=merge, Data3=ln)  # -> flatten(Result)
explode_2 = Explode(Curve=crv_3, Recursive=True)  # -> Segments, Vertices
lng_2 = ListLength(List=move.Geometry)
item_3 = ListItem(List=explode_2.Segments, Index=0, Wrap=True)  # -> Item, Item1, Item2, Item3
crv_4 = Curve(merge_3)
ma = MassAddition(Input=flatten(lng_2))  # -> Result, PartialResults
join = JoinCurves(Curves=crv_4, Preserve=False)
edgesrf_2 = EdgeSurface(CurveA=item_3.Item, CurveB=item_3.Item1, CurveC=item_3.Item2, CurveD=item_3.Item3)
c_script = CSharpScript(crv=flatten(join), color=graft(ColourSwatch(SwatchColor=RGB(255, 15, 15))))  # -> out, A; inputs crv: Curve, color: Color
# ---------- c_script: C# ----------
    var c = color.R + "," + color.G + "," + color.B;
    crv.SetUserString("color", c);
    A = crv;
# ---------- end c_script ----------
pt_2 = ConstructPoint(XCoordinate=Slider(1, range=0..10), YCoordinate="-1", ZCoordinate="-1")
subtraction = Subtraction(A=ma.PartialResults, B="1")
xy_3 = XYPlane(Origin=Point(0, 0, 0))
mjoin = MeshJoin(Meshes=flatten(edgesrf_2))

# ---- group: RH_OUT:crv-people
crv_5 = Curve([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])

# ---- group: RH_OUT:crv-column
crv_6 = Curve(c_script.A)

# ----
mshadow = MeshShadow(Mesh=flatten(mjoin), Light=pt_2, Plane=xy_3)
sort_2 = SortList(Keys=explode_2.Segments)  # -> Keys, ValuesA
srf = Surface(mshadow)
roundf = RoundToFactor(NumberX=sort_2.Keys, Factor="0.01", RoundType=0)  # -> Rounded, Difference, MultiplierR, MultiplierX
mesh = MeshBrep(
    Brep=srf,
    Settings={GridMaxCount=0, GridMinCount=16, JaggedSeams=False, MaxEdgeLength=0, MinEdgeLength=0.0001, MinTolerance=0, Refine=True, RefineAngle=0, RelativeTolerance=0.65, SimplePlanes=True, Tolerance=0})
mesh_2 = MeshBrep(
    Brep=edgesrf_2,
    Settings={GridMaxCount=0, GridMinCount=16, JaggedSeams=False, MaxEdgeLength=0, MinEdgeLength=0.0001, MinTolerance=0, Refine=True, RefineAngle=0, RelativeTolerance=0.65, SimplePlanes=True, Tolerance=0})
area = Area(Geometry=edgesrf_2)  # -> Area, Centroid
number_slider = Slider(0.2, range=0..1)
item_4 = ListItem(List=roundf.Rounded, Index=0, Wrap=True)  # -> Item1, Item
bnd = Bounds(Numbers=flatten(area.Area))
panel_4 = Panel("30")
mesh_3 = Mesh(simplify(flatten(edgesrf_2)))

# ---- group: labels
panel_5 = Panel(subtraction)

# ----
pdecon_3 = Deconstruct(Point=move.Geometry)  # -> XComponent, YComponent, ZComponent
concat = Concatenate(FragmentD=graft(subtraction), FragmentE=". ", FragmentA=item_4.Item1, FragmentB="  x  ", FragmentC=item_4.Item)  # -> flatten(Result)
remap = RemapNumbers(Value=area.Area, Source=bnd, Target="0 to 1")  # -> Mapped, Clipped
gradient = Gradient(
    LowerLimit=0,
    UpperLimit=1,
    Parameter=flatten(remap.Mapped),
    stops=[0: RGB(234, 38, 0), 0.25: RGB(234, 126, 0), 0.5: RGB(254, 244, 84), 0.75: RGB(173, 203, 249), 1: RGB(75, 107, 169)])
mesh_4 = Mesh(mesh)
material = CreateMaterial(Diffuse=flatten(gradient), Specular=RGB(255, 255, 255), Emission=RGB(0, 0, 0), Transparency=0, Shine=0)
roundf_2 = RoundToFactor(NumberX=pdecon_3.ZComponent, Factor=".01", RoundType=0)  # -> Rounded, Difference, MultiplierR, MultiplierX
area_2 = Area(Geometry=srf)  # -> Area, Centroid
concat_2 = Concatenate(FragmentD="#", FragmentA=graft(panel_5), FragmentB=graft("  H "), FragmentC=roundf_2.Rounded)  # -> flatten(Result)
mcol = MeshColours(Mesh=graft(mesh_2), Colours=graft(gradient))
panel_6 = Panel(material)
ma_2 = MassAddition(Input=area_2.Area)  # -> Result, PartialResults
panel_7 = Panel(concat_2)
preview = CustomPreview(Geometry=mesh_3, Material=material)

# ---- group: pavilion area
area_3 = Area(Geometry=crv_2)  # -> Area, Centroid
panel_8 = Panel(area_3.Area)

# ---- group: RH_OUT:shadow
mesh_5 = Mesh([mesh_4, mcol])

# ----
division_2 = Division(A=ma_2.Result, B=area_3.Area)
pt_3 = Point(move.Geometry)
pt_4 = Point(points)

# ---- group: pavilion lift up
panel_9 = Panel(division)

# ----
roundf_3 = RoundToFactor(NumberX=panel_2, Factor="0.01", RoundType=0)  # -> Rounded, Difference, MultiplierR, MultiplierX

# ---- group: shading ratio
panel_10 = Panel(division_2)

# ---- group: panel size
panel_11 = Panel(concat)

# ----
pt_5 = Point(Point(-2.23289143, -1.921641078, 0.9))

# ---- group: number of panels
panel_12 = Panel(lng)

# ----
Z_2 = UnitZ(Factor=".3")
Z_3 = UnitZ(Factor=".3")
get_string = GetString(concat_2, AtLeast=1, AtMost=2147483647)
project_3 = Project(Geometry=pt_5, Plane=PlaneXY(0, 0, 0))  # -> Geometry, Transform
move_2 = Move(Geometry=pt_3, Motion=Z_2)  # -> Geometry, Transform
lng_3 = ListLength(List=flatten(move.Geometry))
move_3 = Move(Geometry=pt_4, Motion=Z_3)  # -> Geometry, Transform
concat_3 = Concatenate(FragmentA="H ", FragmentB=roundf_3.Rounded)
get_string_2 = GetString(concat_3, AtLeast=1, AtMost=2147483647)
roundf_4 = RoundToFactor(NumberX=panel_10, Factor=".01", RoundType=0)  # -> Rounded, Difference, MultiplierR, MultiplierX
roundf_5 = RoundToFactor(NumberX=panel_8, Factor=".01", RoundType=0)  # -> Rounded, Difference, MultiplierR, MultiplierX
xz = XZPlane(Origin=move_2.Geometry)
xz_2 = XZPlane(Origin=move_3.Geometry)
dup = DuplicateData(Data="fabric", Number=lng_3, Order=True)
number_slider_2 = Slider(1, range=0..10)
bool = Boolean(True)
bool_2 = Boolean(True)
c_script_2 = CSharpScript(face="Futura Md", bold=bool, size=Slider(0.15, range=0..11), content=graft(get_string), pl=xz)  # -> out, A; inputs face: String, bold: Boolean, italics: Boolean, size: Double, content: String, pl: Plane
# ---------- c_script_2: C# usings ----------
using System.IO;
using System.Linq;
using System.Data;
using System.Drawing;
using System.Reflection;
using System.Windows.Forms;
using System.Xml;
using System.Xml.Linq;
using System.Runtime.InteropServices;

using Rhino.DocObjects;
using Rhino.Collections;
using GH_IO;
using GH_IO.Serialization;
# ---------- c_script_2: C# ----------
    if(size == 0)
      size = 1;

    if(!string.IsNullOrEmpty(face) && size > 0 && !string.IsNullOrEmpty(content) &&
      pl.IsValid)
    {
      using (var doc = Rhino.RhinoDoc.CreateHeadless(null))
      {
        var te = doc.Objects.AddText(content, pl, size, face, bold, italics);
        var txt = doc.Objects.Find(te) as Rhino.DocObjects.TextObject;

        if(txt != null)
        {
          var tt = txt.Geometry as Rhino.Geometry.TextEntity;
          A = tt.Explode();
        }
      }
    }
# ---------- end c_script_2 ----------
c_script_3 = CSharpScript(face="Futura Md", bold=bool_2, size=Slider(0.2, range=0..11), content=get_string_2, pl=xz_2)  # -> out, A; inputs face: String, bold: Boolean, italics: Boolean, size: Double, content: String, pl: Plane; same code as c_script_2
merge_4 = Merge(Data1="number of panels", Data2=panel_12, Data3="panel size", Data4=flatten(panel_11))
merge_5 = Merge(
    Data1=flatten("shading ratio"),
    Data2=flatten(roundf_4.Rounded),
    Data3="roof lifted-up height(m)",
    Data4=panel_9,
    Data5="  ",
    Data6="  ",
    Data7="pavilion area(sqm)",
    Data8=roundf_5.Rounded)  # -> simplify(graft(Result))
lng_4 = ListLength(List=flatten(merge_5))
lng_5 = ListLength(List=merge_4)
pdecon_4 = Deconstruct(Point=project_3.Geometry)  # -> XComponent, YComponent, ZComponent
slider = Slider(0.2, range=0..11)
series = Series(Start=number_slider_2, Step=expr("x+.5*x", slider), Count=lng_4)
series_2 = Series(Start=number_slider_2, Step=expr("x+.5*x", slider), Count=lng_5)
addition = Addition(A=pdecon_4.XComponent, B="-3")
Z_4 = UnitZ(Factor=series)
Y = UnitY(Factor=series)
get_string_3 = GetString(merge_4, AtLeast=1, AtMost=2147483647)
get_string_4 = GetString(merge_5, AtLeast=1, AtMost=2147483647)
pt_6 = Point(Point(7.507510673, -15.11390341, 0))
pt_7 = Point(project_3.Geometry)
Y_2 = UnitY(Factor=series_2)
pt_8 = ConstructPoint(XCoordinate=addition, YCoordinate=pdecon_4.YComponent, ZCoordinate=pdecon_4.ZComponent)
pt_9 = Point(pt_8)
pt_10 = Point(Point(1.341822978, -15.11390341, 0))
Z_5 = UnitZ(Factor=series_2)
bool_3 = Boolean(True)
neg = Negative(Value=Z_4)
bool_4 = Boolean(True)
xz_3 = XZPlane(Origin=pt_7)
neg_2 = Negative(Value=Z_5)
move_4 = Move(Geometry=xz_3, Motion=neg)  # -> graft(Geometry), Transform
c_script_4 = CSharpScript(face="Futura Md", bold=bool_3, size=Slider(0.2, range=0..11), content=get_string_4, pl=move_4.Geometry)  # -> out, A; inputs face: String, bold: Boolean, italics: Boolean, size: Double, content: String, pl: Plane; same code as c_script_2
xz_4 = XZPlane(Origin=pt_9)
move_5 = Move(Geometry=xz_4, Motion=neg_2)  # -> Geometry, Transform
c_script_5 = CSharpScript(face="Futura Md", bold=bool_4, size=slider, content=get_string_3, pl=move_5.Geometry)  # -> out, A; inputs face: String, bold: Boolean, italics: Boolean, size: Double, content: String, pl: Plane; same code as c_script_2

# ---- group: RH_OUT:text_lines
crv_7 = Curve(flatten([c_script_2.A, c_script_3.A, c_script_5.A, c_script_4.A]))

# ----
c_script_6 = CSharpScript(crv=flatten(crv_7), color=graft(ColourSwatch(SwatchColor=RGB(255, 43, 43))))  # -> out, A; inputs crv: Curve, color: Color; same code as c_script
crv_8 = Curve(flatten(c_script_6.A))
