# Grasshopper definition veryfunproject-test-d.gh (Grasshopper 1.0.7)
# plug-ins: Kangaroo2 Components, Pufferfish

# ---- group: RH_IN:points
pt = Point([Point(-11.04668324, 4.014054511, 4.015371391), Point(-10.14495715, -9.694783434, 6.1939195), Point(4.948946065, 0.8536388214, 6.612655063), Point(4.365836567, -9.910899729, 0.8630278738)])

# ----
points = GetPoint(pt, AtLeast=1, AtMost=2147483647, Realtime=True)
pdecon = Deconstruct(Point=points)  # -> XComponent, YComponent, ZComponent
udivision = GetNumber(Slider(3, range=1..5), AtLeast=1, AtMost=2147483647, Maximum=1.797693135e+308, Minimum=-1.797693135e+308)
vdivision = GetNumber(Slider(3, range=1..5), AtLeast=1, AtMost=2147483647, Maximum=1.797693135e+308, Minimum=-1.797693135e+308)
openingheight = GetNumber(Slider(6, range=0..10), AtLeast=1, AtMost=2147483647, Maximum=1.797693135e+308, Minimum=-1.797693135e+308)
sort = SortList(Keys=pdecon.ZComponent)  # -> Keys, ValuesA
xy = XYPlane(Origin=Point(0, 0, 0))
pdecon_2 = Deconstruct(Point=points)  # -> XComponent, YComponent, ZComponent
hull = ConvexHull(Points=points, Plane=PlaneXY(0, 0, 0))  # -> Hull, HullZ, Indices
division = Division(A=openingheight, B="10")
project = Project(Geometry=points, Plane=xy)  # -> Geometry, Transform
crv = Curve(hull.HullZ)
ln = Line(StartPoint=project.Geometry, EndPoint=points)
item = ListItem(List=reverse(sort.Keys), Index=0, Wrap=True)
explode = Explode(Curve=crv, Recursive=True)  # -> Segments, Vertices
mp = MultiPipe(Curves=ln, NodeSize=".3", EndOffset=1, StrutSize=".3", Segment=0, KinkAngle=0.6, CubeFit=0)  # disabled
item_2 = ListItem(List=explode.Segments, Index=0, Wrap=True)  # -> Item, Item1, Item2, Item3
crv_2 = Curve(hull.Hull)
edgesrf = EdgeSurface(CurveA=item_2.Item, CurveB=item_2.Item1, CurveC=item_2.Item2, CurveD=item_2.Item3)
sdivide = DivideSurface(Surface=edgesrf, UCount=udivision, VCount=vdivision)  # -> Points, Normals, Parameters
divide = DivideDomain²(Domain=edgesrf, UCount=udivision, VCount=vdivision)
number_slider = Slider(5, range=0..10)
flip = FlipMatrix(Data=sdivide.Points)
subsrf = Isotrim(Surface=edgesrf, Domain=divide)
pline = PolyLine(Vertices=sdivide.Points, Closed=False)
pline_2 = PolyLine(Vertices=flip, Closed=False)
debrep = DeconstructBrep(Brep=subsrf)  # -> Faces, Edges, Vertices
merge = Merge(Data1=pline_2, Data2=pline)
pdecon_3 = Deconstruct(Point=debrep.Vertices)  # -> XComponent, YComponent, ZComponent
sort_2 = SortList(Keys=pdecon_3.ZComponent, ValuesA=debrep.Vertices)  # -> Keys, ValuesA
Z = UnitZ(Factor="-1")
mp_2 = MultiPipe(Curves=flatten(merge), NodeSize=".05", EndOffset=".2", StrutSize=".2", Segment=0, KinkAngle=0.6, CubeFit=0)  # disabled
extr = Extrude(Base=merge, Direction=Z)
item_3 = ListItem(List=sort_2.ValuesA, Index=0, Wrap=True)  # -> Item, Item1, Item2, Item3
project_2 = Project(Geometry=item_3.Item, Plane=PlaneXY(0, 0, 0))  # -> Geometry, Transform
Z_2 = UnitZ(Factor=division)
move = Move(Geometry=item_3.Item, Motion=Z_2)  # -> Geometry, Transform
ln_2 = Line(StartPoint=project_2.Geometry, EndPoint=move.Geometry)  # -> simplify(Line)
crv_3 = Curve(subsrf)
merge_2 = Merge(Data1=move.Geometry, Data2=item_3.Item1, Data3=item_3.Item2, Data4=item_3.Item3)
mp_3 = MultiPipe(Curves=ln_2, NodeSize=".15", EndOffset=1, StrutSize=".15", Segment=0, KinkAngle=0.6, CubeFit=0)  # disabled
hull_2 = ConvexHull(Points=merge_2, Plane=PlaneXY(0, 0, 0))  # -> Hull, HullZ, Indices
crv_4 = Curve(hull_2.HullZ)
explode_2 = Explode(Curve=crv_4, Recursive=True)  # -> Segments, Vertices
lng = ListLength(List=move.Geometry)
item_4 = ListItem(List=explode_2.Segments, Index=0, Wrap=True)  # -> Item, Item1, Item2, Item3
ma = MassAddition(Input=flatten(lng))  # -> Result, PartialResults
edgesrf_2 = EdgeSurface(CurveA=item_4.Item, CurveB=item_4.Item1, CurveC=item_4.Item2, CurveD=item_4.Item3)
pt_2 = ConstructPoint(XCoordinate=Slider(1, range=0..10), YCoordinate="-1", ZCoordinate="-1")
subtraction = Subtraction(A=ma.PartialResults, B="1")
mjoin = MeshJoin(Meshes=flatten(edgesrf_2))
xy_2 = XYPlane(Origin=Point(0, 0, 0))
mesh = Mesh(simplify(edgesrf_2))
mshadow = MeshShadow(Mesh=flatten(mjoin), Light=pt_2, Plane=xy_2)
sort_3 = SortList(Keys=explode_2.Segments)  # -> Keys, ValuesA
srf = Surface(mshadow)
roundf = RoundToFactor(NumberX=sort_3.Keys, Factor="0.01", RoundType=0)  # -> Rounded, Difference, MultiplierR, MultiplierX
mesh_2 = MeshBrep(
    Brep=srf,
    Settings={GridMaxCount=0, GridMinCount=16, JaggedSeams=False, MaxEdgeLength=0, MinEdgeLength=0.0001, MinTolerance=0, Refine=True, RefineAngle=0, RelativeTolerance=0.65, SimplePlanes=True, Tolerance=0})
mesh_3 = Mesh(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)
merge_3 = Merge(Data1=ln_2, Data2=merge, Data3=ln)
item_5 = ListItem(List=roundf.Rounded, Index=0, Wrap=True)  # -> Item1, Item
area = Area(Geometry=edgesrf_2)  # -> Area, Centroid
medges = MeshEdges(Mesh=mesh_3)  # -> NakedEdges, InteriorEdges, NonManifoldEdges
mcol = MeshColours(Mesh=mesh_2, Colours=ColourSwatch(SwatchColor=RGBA(148, 126, 126, 82)))
mcol_2 = MeshColours(Mesh=mesh_3, Colours=ColourSwatch(SwatchColor=RGB(255, 25, 0)))
lng_2 = ListLength(List=flatten(divide))
crv_5 = Curve(medges.NakedEdges)

# ---- group: labels
panel = Panel(subtraction)

# ----
pdecon_4 = Deconstruct(Point=move.Geometry)  # -> XComponent, YComponent, ZComponent
concat = Concatenate(FragmentD=graft(subtraction), FragmentE=". ", FragmentA=item_5.Item1, FragmentB="  x  ", FragmentC=item_5.Item)  # -> flatten(Result)
bnd = Bounds(Numbers=flatten(area.Area))
crv_6 = Curve(merge_3)
roundf_2 = RoundToFactor(NumberX=pdecon_4.ZComponent, Factor=".01", RoundType=0)  # -> Rounded, Difference, MultiplierR, MultiplierX
c_script = CSharpScript(crv=flatten(crv_5), color=graft(ColourSwatch(SwatchColor=RGB(255, 255, 255))))  # -> out, A; inputs crv: Curve, color: Color
# ---------- c_script: C# ----------
    var c = color.R + "," + color.G + "," + color.B;
    crv.SetUserString("color", c);
    A = crv;
# ---------- end c_script ----------
remap = RemapNumbers(Value=area.Area, Source=bnd, Target="0 to 1")  # -> Mapped, Clipped
area_2 = Area(Geometry=srf)  # -> Area, Centroid
concat_2 = Concatenate(FragmentD="#", FragmentA=graft(panel), FragmentB=graft("  H "), FragmentC=roundf_2.Rounded)  # -> flatten(Result)
c_script_2 = CSharpScript(crv=flatten(crv_6), color=graft(ColourSwatch(SwatchColor=RGB(255, 15, 15))))  # -> out, A; inputs crv: Curve, color: Color; same code as c_script
gradient = Gradient(LowerLimit=0, UpperLimit=1, Parameter=remap.Mapped, stops=[0: RGB(148, 148, 148), 1: RGB(74, 74, 74)])

# ---- group: point heights
panel_2 = Panel(pdecon_2.ZComponent)

# ----
ma_2 = MassAddition(Input=area_2.Area)  # -> Result, PartialResults
panel_3 = Panel(concat_2)

# ---- group: pavilion area
area_3 = Area(Geometry=crv_2)  # -> Area, Centroid
panel_4 = Panel(area_3.Area)

# ----
division_2 = Division(A=ma_2.Result, B=area_3.Area)
mcol_3 = MeshColours(Mesh=mesh, Colours=gradient)
panel_5 = Panel("How are you? ")
pt_3 = Point(move.Geometry)
pt_4 = Point(points)

# ---- group: pavilion lift up
panel_6 = Panel(division)

# ----
roundf_3 = RoundToFactor(NumberX=panel_2, Factor="0.01", RoundType=0)  # -> Rounded, Difference, MultiplierR, MultiplierX

# ---- group: panel size
panel_7 = Panel(concat)

# ---- group: number of panels
panel_8 = Panel(lng_2)

# ---- group: shading ratio
panel_9 = Panel(division_2)

# ----
Z_3 = UnitZ(Factor=".3")
Z_4 = UnitZ(Factor=".3")
mesh_4 = Mesh([mp_2, mp_3, mp])  # disabled
get_string = GetString(concat_2, AtLeast=1, AtMost=2147483647)
move_2 = Move(Geometry=pt_3, Motion=Z_3)  # -> Geometry, Transform
lng_3 = ListLength(List=flatten(move.Geometry))
move_3 = Move(Geometry=pt_4, Motion=Z_4)  # -> Geometry, Transform
mjoin_2 = MeshJoin(Meshes=flatten(mesh_4))  # disabled
concat_3 = Concatenate(FragmentA="H ", FragmentB=roundf_3.Rounded)
get_string_2 = GetString(concat_3, AtLeast=1, AtMost=2147483647)
swatch = ColourSwatch(SwatchColor=RGB(150, 150, 150))  # disabled
roundf_4 = RoundToFactor(NumberX=panel_9, Factor=".01", RoundType=0)  # -> Rounded, Difference, MultiplierR, MultiplierX
roundf_5 = RoundToFactor(NumberX=panel_4, Factor=".01", RoundType=0)  # -> Rounded, Difference, MultiplierR, MultiplierX
mjoin_3 = MeshJoin(Meshes=flatten(mcol_3))
xz = XZPlane(Origin=move_2.Geometry)
xz_2 = XZPlane(Origin=move_3.Geometry)
dup = DuplicateData(Data="fabric", Number=lng_3, Order=True)
number_slider_2 = Slider(1, range=0..10)
bool = Boolean(True)
bool_2 = Boolean(True)
mcol_4 = MeshColours(Mesh=mjoin_2, Colours=swatch)  # disabled
c_script_3 = CSharpScript(face="Futura Md", bold=bool, size=Slider(0.15, range=0..11), content=graft(get_string), pl=xz)  # -> out, A; inputs face: String, bold: Boolean, italics: Boolean, size: Double, content: String, pl: Plane
# ---------- c_script_3: C# usings ----------
using System.IO;
using System.Linq;
using System.Data;
using System.Drawing;
using System.Reflection;
using System.Windows.Forms;
using System.Xml;
using System.Xml.Linq;
using System.Runtime.InteropServices;

using Rhino.DocObjects;
using Rhino.Collections;
using GH_IO;
using GH_IO.Serialization;
# ---------- c_script_3: C# ----------
    if(size == 0)
      size = 1;

    if(!string.IsNullOrEmpty(face) && size > 0 && !string.IsNullOrEmpty(content) &&
      pl.IsValid)
    {
      using (var doc = Rhino.RhinoDoc.CreateHeadless(null))
      {
        var te = doc.Objects.AddText(content, pl, size, face, bold, italics);
        var txt = doc.Objects.Find(te) as Rhino.DocObjects.TextObject;

        if(txt != null)
        {
          var tt = txt.Geometry as Rhino.Geometry.TextEntity;
          A = tt.Explode();
        }
      }
    }
# ---------- end c_script_3 ----------
c_script_4 = CSharpScript(face="Futura Md", bold=bool_2, size=Slider(0.2, range=0..11), content=get_string_2, pl=xz_2)  # -> out, A; inputs face: String, bold: Boolean, italics: Boolean, size: Double, content: String, pl: Plane; same code as c_script_3
merge_4 = Merge(Data1="number of panels", Data2=panel_8, Data3="panel size", Data4=flatten(panel_7))
merge_5 = Merge(
    Data1=flatten("shading ratio"),
    Data2=flatten(roundf_4.Rounded),
    Data3="roof lifted-up height(m)",
    Data4=panel_6,
    Data5="  ",
    Data6="  ",
    Data7="pavilion area(sqm)",
    Data8=roundf_5.Rounded)  # -> simplify(graft(Result))
lng_4 = ListLength(List=flatten(merge_5))
lng_5 = ListLength(List=merge_4)
mesh_5 = Mesh(mcol)
mesh_6 = Mesh(mcol_4)  # disabled
mesh_7 = Mesh(mjoin_3)
slider = Slider(0.2, range=0..11)
series = Series(Start=number_slider_2, Step=expr("x+.5*x", slider), Count=lng_4)
series_2 = Series(Start=number_slider_2, Step=expr("x+.5*x", slider), Count=lng_5)
get_string_3 = GetString(merge_5, AtLeast=1, AtMost=2147483647)
Z_5 = UnitZ(Factor=series)
Y = UnitY(Factor=series)
get_string_4 = GetString(merge_4, AtLeast=1, AtMost=2147483647)
pt_5 = Point(Point(7.507510673, -15.11390341, 0))
pt_6 = Point(Point(4.13042098, -15.11390341, 0))
Y_2 = UnitY(Factor=series_2)
mjoin_4 = MeshJoin(Meshes=flatten([mesh_7, mesh_5]))
pt_7 = Point(Point(7.507510673, -15.11390341, 0))
pt_8 = Point(Point(1.341822978, -15.11390341, 0))
Z_6 = UnitZ(Factor=series_2)
bool_3 = Boolean(True)
neg = Negative(Value=Z_5)
bool_4 = Boolean(True)
xz_3 = XZPlane(Origin=pt_6)
neg_2 = Negative(Value=Z_6)
move_4 = Move(Geometry=xz_3, Motion=neg)  # -> graft(Geometry), Transform
c_script_5 = CSharpScript(face="Futura Md", bold=bool_3, size=Slider(0.2, range=0..11), content=get_string_3, pl=move_4.Geometry)  # -> out, A; inputs face: String, bold: Boolean, italics: Boolean, size: Double, content: String, pl: Plane; same code as c_script_3

# ---- group: RH_OUT:pavilion
mesh_8 = Mesh(mjoin_4)

# ---- group: RH_OUT:people
mesh_9 = Mesh(mcol_2)

# ---- group: RH_OUT:crv-people
crv_7 = Curve([c_script.A, c_script_2.A])

# ----
xz_4 = XZPlane(Origin=pt_7)
move_5 = Move(Geometry=xz_4, Motion=neg_2)  # -> Geometry, Transform
c_script_6 = CSharpScript(face="Futura Md", bold=bool_4, size=slider, content=get_string_4, pl=move_5.Geometry)  # -> out, A; inputs face: String, bold: Boolean, italics: Boolean, size: Double, content: String, pl: Plane; same code as c_script_3

# ---- group: RH_OUT:text_lines
crv_8 = Curve(flatten([c_script_3.A, c_script_4.A, c_script_6.A, c_script_5.A]))
