# Grasshopper definition veryfunproject.gh (Grasshopper 1.0.7)
# plug-ins: Squid (ShapeDiver Edition), Pufferfish, Kangaroo2 Components

vec = VectorXYZ(XComponent="-1", YComponent="-1", ZComponent=0)  # -> Vector, Length
vec_2 = VectorXYZ(XComponent="1", YComponent="-1", ZComponent=0)  # -> Vector, Length
vec_3 = VectorXYZ(XComponent="-1", YComponent="1", ZComponent=0)  # -> Vector, Length
vec_4 = VectorXYZ(XComponent="1", YComponent="1", ZComponent=0)  # -> Vector, Length
pt = ConstructPoint(XCoordinate="-1", YCoordinate="1", ZCoordinate=0)
pt_2 = ConstructPoint(XCoordinate="1", YCoordinate="1", ZCoordinate=0)
pt_3 = ConstructPoint(XCoordinate="1", YCoordinate="-1", ZCoordinate=0)
pt_4 = ConstructPoint(XCoordinate="-1", YCoordinate="-1", ZCoordinate=0)
amp = Amplitude(Vector=vec_3.Vector, Amplitude=Slider(32, range=1..40))
amp_2 = Amplitude(Vector=vec_4.Vector, Amplitude=Slider(25, range=1..40))
amp_3 = Amplitude(Vector=vec_2.Vector, Amplitude=Slider(31, range=1..40))
amp_4 = Amplitude(Vector=vec.Vector, Amplitude=Slider(16, range=1..40))
avr = Average(Input=[pt, pt_2, pt_3, pt_4])
move = Move(Geometry=avr, Motion=amp_4)  # -> Geometry, Transform
move_2 = Move(Geometry=avr, Motion=amp_3)  # -> Geometry, Transform
move_3 = Move(Geometry=avr, Motion=amp_2)  # -> Geometry, Transform
move_4 = Move(Geometry=avr, Motion=amp)  # -> Geometry, Transform
merge = Merge(Data1=move_4.Geometry, Data2=move_3.Geometry, Data3=move_2.Geometry, Data4=move.Geometry)
number_slider = Slider(14, range=4..14)
pline = PolyLine(Vertices=merge, Closed=invert(False))
random = Random(Range="5 to 7", Number=number_slider, Seed=2)
explode = Explode(Curve=pline, Recursive=True)  # -> Segments, Vertices
srf = Surface(pline)
Z = UnitZ(Factor=random)
len = Length(Curve=explode.Segments)
area = Area(Geometry=srf)  # -> Area, Centroid
popgeo = PopulateGeometry(Geometry=srf, Count=number_slider, Seed=Slider(96, range=0..100))
midpt = CurveMiddle(Curve=explode.Segments)
roundf = RoundToFactor(NumberX=len, Factor="0.01", RoundType=0)  # -> Rounded, Difference, MultiplierR, MultiplierX
move_5 = Move(Geometry=popgeo, Motion=Z)  # -> Geometry, Transform
vec2pt = Vector2Pt(PointA=avr, PointB=midpt, Unitize=False)  # -> Vector, Length
txt = Text(area.Area)
vlen = VectorLength(Vector=vec2pt.Vector)
ln = Line(StartPoint=popgeo, EndPoint=move_5.Geometry)
addition = Addition(A=vec2pt.Length, B=Slider(5, range=0..10))
panel = Panel(txt)
paragraph = Paragraph(HAlign="1", VAlign="1", RightLeft=False)
font = Font(Family="Futura Md BT", Size=Slider(0.8, range=0..1), Bold=False, Italic=False, Underline=False)
txt_2 = Text(roundf.Rounded)
amp_5 = Amplitude(Vector=vec2pt.Vector, Amplitude=addition)
voronoi = Voronoi(Points=popgeo, BruteForceOverride=False)
mp = MultiPipe(Curves=ln, NodeSize=0.5, EndOffset=1, StrutSize=".5", Segment=0, KinkAngle=0.6, CubeFit=0)
move_6 = Move(Geometry=avr, Motion=amp_5)  # -> Geometry, Transform
textc = TextCurves(Plane=move_6.Geometry, Text=txt_2, Font=font, Paragraph=paragraph)
number_slider_2 = Slider(2, range=1.5..2)
division = Division(A=number_slider_2, B="2")
mp_2 = MultiPipe(
    Curves=voronoi,
    NodeSize=number_slider_2,
    EndOffset=number_slider_2,
    StrutSize=division,
    Segment=0,
    KinkAngle=0.6,
    CubeFit=0)
subdedges = SubDEdges(SubD=mp_2, NewFormatting=False)  # -> Line, Edge, Tag, Id
crv = Curve(subdedges.Edge)
project = Project(Curve=crv, Brep=srf, Direction=Vector(0, 0, 1))
srfsplit = SurfaceSplit(Surface=srf, Curves=flatten(project))
area_2 = Area(Geometry=srfsplit)  # -> Area, Centroid
sort = SortList(Keys=area_2.Area, ValuesA=srfsplit)  # -> Keys, reverse(ValuesA)
series = Series(Start=0, Step=1, Count=number_slider)
cull_i = CullIndex(List=sort.ValuesA, Indices=series, Wrap=True)
item = ListItem(List=sort.ValuesA, Index=series, Wrap=True)
join = BrepJoin(Breps=cull_i)  # -> Breps, Closed
debrep = DeconstructBrep(Brep=item)  # -> flatten(Faces), Edges, Vertices
fmerge = MergeFaces(Brep=join.Breps)  # -> Breps, Before, After
area_3 = Area(Geometry=debrep.Faces)  # -> Area, Centroid
Z_2 = UnitZ(Factor="-.2")
extr = Extrude(Base=debrep.Faces, Direction=Z_2)
scale = Scale(Geometry=debrep.Vertices, Center=graft(area_3.Centroid), Factor=Slider(0.9, range=0..10))  # -> Geometry, Transform
move_7 = Move(Geometry=[join.Breps, fmerge.Breps], Motion=Z_2)  # -> Geometry, Transform
hull = ConvexHull(Points=debrep.Vertices, Plane=PlaneXY(0, 0, 0))  # -> Hull, HullZ, Indices
preview = CustomPreview(Geometry=move_7.Geometry, Material=ColourSwatch(SwatchColor=RGB(255, 142, 97)))
preview_2 = CustomPreview(Geometry=extr, Material=ColourSwatch(SwatchColor=RGB(255, 255, 255)))
alongcrv = SortAlongCurve(Points=scale.Geometry, Curve=hull.Hull)  # -> Points, Indices
nurbs = NurbsCurve(Vertices=alongcrv.Points, Degree="3", Periodic=invert(False))  # -> Curve, Length, Domain
extr_2 = Extrude(Base=nurbs.Curve, Direction=graft(Z))
area_4 = Area(Geometry=nurbs.Curve)  # -> Area, Centroid
cap = CapHoles(Brep=extr_2)
volume = Volume(Geometry=cap)  # -> Volume, Centroid
sort_2 = SortList(Keys=flatten(volume.Volume))  # -> Keys, ValuesA
item_2 = ListItem(List=reverse(sort_2.Keys), Index=Slider(38, range=0..100), Wrap=True)
division_2 = Division(A=item_2, B=area_4.Area)
Z_3 = UnitZ(Factor=division_2)
extr_3 = Extrude(Base=nurbs.Curve, Direction=Z_3)
cap_2 = CapHoles(Brep=extr_3)
panel_2 = Panel(volume.Volume)
volume_2 = Volume(Geometry=cap_2)  # -> Volume, Centroid
number_slider_3 = Slider(0.88, range=0..1)
panel_3 = Panel(volume_2.Volume)
dom²num = ConstructDomain²(UMin=0, UMax=Slider(1, range=0..1), VMin=0, VMax=number_slider_3)
dom²num_2 = ConstructDomain²(UMin=0, UMax=1, VMin=number_slider_3, VMax=1)
debrep_2 = DeconstructBrep(Brep=cap_2)  # -> Faces, Edges, Vertices
subsrf = Isotrim(Surface=reparameterize(extr_3), Domain=dom²num_2)
subsrf_2 = Isotrim(Surface=reparameterize(extr_3), Domain=dom²num)
item_3 = ListItem(List=debrep_2.Faces, Index=0, Wrap=True)  # -> Item, Item1
Z_4 = UnitZ(Factor=".25")
extr_4 = Extrude(Base=item_3.Item1, Direction=Z_4)
merge_2 = Merge(Data1=simplify(extr_4), Data2=simplify(subsrf_2))
join_2 = BrepJoin(Breps=merge_2)  # -> Breps, Closed
# number of housing units
panel_4 = Panel("opening area")
panel_5 = Panel("building area")
panel_6 = Panel("land area")
mcol = MeshColours(Mesh=subsrf, Colours=ColourSwatch(SwatchColor=RGBA(102, 120, 242, 55)))
panel_7 = Panel("volume")
mcol_2 = MeshColours(Mesh=join_2.Breps, Colours=ColourSwatch(SwatchColor=RGB(140, 212, 200)))
mesh = Mesh(mcol)
mesh_2 = Mesh(mcol_2)
medges = MeshEdges(Mesh=mesh_2)  # -> NakedEdges, InteriorEdges, NonManifoldEdges
crv_2 = Curve(medges.NakedEdges)
